# Grasshopper definition test-file.gh (Grasshopper 1.0.7)
# plug-ins: Mallard

boolean_toggle = BooleanToggle(True)
list_airtable_records = ListAirtableRecords(Refresh=boolean_toggle, BaseID="appGn6JoC0exZvTr8", AppKey="keyjNDU2X6XRFOsxc", TableName="People")  # -> ErrorMessage, OutRecords
get_airtable_record = GetAirtableRecord(
    Refresh=boolean_toggle,
    BaseID="appGn6JoC0exZvTr8",
    AppKey="keyjNDU2X6XRFOsxc",
    TableName="People",
    RecordID="recDw9FpxMpE8vFtg")  # -> ErrorMessage, OutRecord
panel = Panel(list_airtable_records.OutRecords)
panel_2 = Panel(list_airtable_records.ErrorMessage)
